# Dynamo custom node Python bin() Funciton.dyf (Dynamo 2.0.3.8810)
# category: Python.Functions

int = Input(int: var[]..[])
python_bin_function = Python(IN[0]=int)
# ---------- python_bin_function.python (7 lines) ----------
# Created by Dalton Goodwin, for learning purposes. Please email me at dalton.c.goodwin@gmail or reach out on LinkedIn for any questions.

#This is a very simple funciton, to use. It converts a int number to a binary string prefixed with 0b
x = IN[0]


OUT = [bin(x), format(x, 'b')]
# ----------------------------------------
