# Dynamo custom node Python callable() Function.dyf (Dynamo 2.0.3.8810)
# category: Python.Functions

var = Input(var: var[]..[])
python_callable_fuction = Python(IN[0]=var)
# ---------- python_callable_fuction.python (6 lines) ----------
# Created by Dalton Goodwin, for learning purposes. Please email me at dalton.c.goodwin@gmail or reach out on LinkedIn for any questions.

#Returns if the input is callable
x = IN[0]

OUT = (callable(x))
# ----------------------------------------
