# Dynamo custom node Python format() Function.dyf (Dynamo 2.0.3.8810)
# category: Python.Functions

# note: Use {} to indicate where the var should go.
string = Input(string: var[]..[])
var = Input(var: var[]..[])
python_format_function = Python(IN[0]=string, IN[1]=var)
# ---------- python_format_function.python (6 lines) ----------
# Created by Dalton Goodwin, for learning purposes. Please email me at dalton.c.goodwin@gmail or reach out on LinkedIn for any questions.

#This method lets us concatenate elements within a string through positional formatting.
x = IN[0]
y = IN[1]
OUT = (x.format(y))
# ----------------------------------------
